# Grasshopper definition Assignment_1_Twisted Pipes.gh (Grasshopper 1.0.8)

range = Range(Domain=Slider(6, range=0..10), Steps=Slider(11, range=0..100))
cir = Circle(Plane=PlaneXY(0, 0, 0), Radius=range)
Z = UnitZ(Factor=expr("x^2", reverse(range)))
number = GetNumber(Slider(8, range=0..10), AtLeast=1, AtMost=1, Maximum=1.797693135e+308, Minimum=-1.797693135e+308, TreeAccess=False)
domain = GetNumber(Slider(8, range=0..10), AtLeast=1, AtMost=1, Maximum=1.797693135e+308, Minimum=-1.797693135e+308, TreeAccess=False)
move = Move(Geometry=cir, Motion=Z)  # -> Geometry, Transform
range_2 = Range(Domain=domain, Steps=number)
boundary = BoundarySurfaces(Edges=move.Geometry)
popgeo = PopulateGeometry(Geometry=boundary, Count=Slider(14, range=0..100), Seed=range_2)
flip = FlipMatrix(Data=popgeo)
Z_2 = UnitZ(Factor=Slider(1, range=0..1))
intcrv_t = InterpolateT(Vertices=flip, TangentStart=Z_2, TangentEnd=Z_2, KnotStyle=1)  # -> Curve, Length, Domain
eval = EvaluateLength(Curve=intcrv_t.Curve, Length=[Slider(0, range=0..100), Slider(1, range=0..1), Slider(0.2, range=0..1)], Normalized=True)  # -> Point, Tangent, Parameter
vpipe = PipeVariable(
    Curve=intcrv_t.Curve,
    Parameters=eval.Parameter,
    Radii=[Slider(0, range=0..1), Slider(0.33, range=0..1), Slider(0.11, range=0..1)],
    Caps=0)
geo = Geometry(vpipe)
context_bake = ContextBake(Geometry=geo)
